# Grasshopper definition ViveTracking_Template.gh (Grasshopper 1.0.8)
# plug-ins: Heteroptera, MeshEdit Components, Robot Components, Pufferfish, ViveTcpRecorderV2, Human, PRC.GH, Weaverbird, Mesh Pipe

vivelistener = ViveTCPListenerV2(AutoUpdate=Toggle(True), IP="127.0.0.1:7000")  # -> Msg, Vive, Plane, Time
quadmesh = Mesh(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)
mesh = Mesh(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)

mesh_trakker_pen = Mesh(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)
xy = XYPlane(Origin=Point(0, 0, 0))

tracker = ViveTracker(Vive=vivelistener.Vive, Index=0, Pause=False)  # -> Tracker, Plane, Matrix, TrackerData, Trigger
lighthouse3 = ViveLighthouse(Vive=vivelistener.Vive, Index=0, AssignedIndex=2, Pause=False, UserSetIndex=False)  # -> Lighthouse, Plane, Matrix
lighthouse2 = ViveLighthouse(Vive=vivelistener.Vive, Index=0, AssignedIndex=1, Pause=False, UserSetIndex=False)  # -> Lighthouse, Plane, Matrix
lighthouse1 = ViveLighthouse(Vive=vivelistener.Vive, Index=0, AssignedIndex=0, Pause=False, UserSetIndex=False)  # -> Lighthouse, Plane, Matrix
lighthouse4 = ViveLighthouse(Vive=vivelistener.Vive, Index=0, AssignedIndex=3, Pause=False, UserSetIndex=False)  # -> Lighthouse, Plane, Matrix
brep = Brep(<brep referenced from the Rhino model>)
brep_2 = Brep(<brep referenced from the Rhino model>)
merge = Merge(Data1=lighthouse3.Lighthouse, Data2=lighthouse2.Lighthouse, Data3=lighthouse1.Lighthouse, Data4=lighthouse4.Lighthouse)
merge_2 = Merge(Data1=lighthouse3.Plane, Data2=lighthouse2.Plane, Data3=lighthouse1.Plane, Data4=lighthouse4.Plane)
Y = UnitY(Factor=1)

# ---- group: Fast slicer
brep_3 = Geometry(brep)
unit_z = UnitZ(Factor=1)
slicing_distance = Panel("7")
number = Number(slicing_distance)
contour = Contour(Shape=brep_3, Point=Point(0, 0, 0), Direction=Y, Distance=number)
curve = Curve(contour)

# ----
pv = PlaneVisualizer(Plane=tracker.Plane)
orient = Orient(Geometry=quadmesh, Source=xy, Target=tracker.Plane)  # -> Geometry, Transform
center_of_rotation = Point(Point(67.97348602, 818.3572586, 62.50000145))
pt = Point(Point(264.0453355, 0, 98.18518537))
toolholder = Brep([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])
list = ValueList({"0", "22.5", "45"}, selected="45")
carving_tool = Mesh(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)
yz = YZPlane(Origin=pt)
merge_3 = Merge(Data1=carving_tool, Data2=toolholder, Data3=yz)
xz = XZPlane(Origin=center_of_rotation)
geo = Geometry([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])
rotate = Rotate(Geometry=merge_3, Angle=degrees(list), Plane=xz)  # -> Geometry, Transform
brep_4 = Brep(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)

# ---- group: Ensure even division of the curve and conservation of enclosure/opening
rebuild_distance = Panel("3")
curve_2 = Curve(curve)
graft_tree = GraftTree(Tree=curve_2, IncludeEmptyLists=True, IncludeNullItems=True)
length = Length(Curve=graft_tree)
division = Division(A=length, B=rebuild_distance)
divide_curve = DivideCurve(Curve=graft_tree, Count=division, Kinks=False)  # -> simplify(Points), Tangents, Parameters
closed = Closed(Curve=graft_tree)  # -> simplify(Closed), Periodic
polyline = PolyLine(Vertices=divide_curve.Points, Closed=closed.Closed)

# ----
merge_4 = Merge(Data1=rotate.Geometry, Data2=brep_4, Data3=geo)
item = ListItem(List=rotate.Geometry, Index="3", Wrap=True)
preview = CustomPreview(Geometry=merge_4, Material=ColourSwatch(SwatchColor=RGB(230, 230, 230)))
dam = DataDam(DataA=merge_4, BufferDelay=10000000, BufferMode=0)
mjoin = MeshJoin(Meshes=dam)
qrmesh = QuadRemesh(Geometry=mjoin, Settings={aqc=True, as=50, dhe=True, gci=0, null=False, pme=2, sa=0, tqc=2000})
mesh_2 = Mesh(qrmesh)

only_scanner_mesh = Mesh(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)
pt_2 = ConstructPoint(XCoordinate=0, YCoordinate="24.08", ZCoordinate="128.26")
frame = FrameViaPlane(Plane=item, FrameID="1")
custom_tool = CustomTool(
    ToolFrame=frame,
    Mesh=mesh_2,
    PRC_AutoHulls_MaxHulls=64,
    PRC_AutoHulls_Tolerance=5,
    PRC_AutoHulls_Version=3,
    PRC_AutoHulls_Part0_Unfinished=0,
    PRC_AutoHulls_Part0_UsedTolerance=7.5,
    PRC_AutoHulls_Part0_DataCRC=-191810505)

axis_6dof = AXISMotion6DOF(
    A01=Slider(-81, range=-180..180),
    A02=Slider(-27, range=-180..180),
    A03=Slider(45, range=-180..180),
    A04=Slider(0, range=0..180),
    A05=Slider(-13, range=-90..180),
    A06=Slider(0, range=0..180),
    Speed=0)
ptp_path = PTPPath(PTPMotions=axis_6dof, Interpolation="C_PTP")

# ---- group: Ensure even division of the curve and conservation of enclosure/opening / Toolpath preview
curve_3 = Curve(polyline)

# ---- group: Ensure even division of the curve and conservation of enclosure/opening / Straight lines loses divisions
discontinuity = Discontinuity(Curve=curve_3, Level=3)  # -> Points, Parameters; disabled

# ---- group: Ensure even division of the curve and conservation of enclosure/opening / Toolpath Gcode
point = Point(divide_curve.Points)

# ----
abb_irb6620 = ABBIRB662015022()

pt_3 = ConstructPoint(XCoordinate="632.82", YCoordinate="-1828.57", ZCoordinate="816.83")
pt_4 = ConstructPoint(XCoordinate="616.07", YCoordinate="-2300.50", ZCoordinate="812.05")
pt_5 = ConstructPoint(XCoordinate="1241.75", YCoordinate="-1870.87", ZCoordinate="813.61")
merge_5 = Merge(Data1=pt_3, Data2=pt_4, Data3=pt_5)
rec_3pt = Rectangle3Pt(PointA=pt_3, PointB=pt_5, PointC=pt_4)  # -> Rectangle, Length
points = PointList(Points=merge_5, Size=Slider(45, range=0..100))
pl_3pt = Plane3Pt(PointA=pt_3, PointB=pt_4, PointC=pt_5)
boundary = BoundarySurfaces(Edges=rec_3pt.Rectangle)
Z = UnitZ(Factor=Slider(-20, range=-100..0))
extr = Extrude(Base=boundary, Direction=Z)

toolpath = Curve(curve_3)
layer_thickness = Panel("15")
print_width = Panel("15")

# ----
# Light Toolpath Preview
clean_angles_lower_than = Panel("15")
radians = Radians(Degrees=clean_angles_lower_than)
_2 = _2(A=number)
_2_2 = _2(A=print_width)
simplify_curve = SimplifyCurve(Curve=toolpath, Tolerance=number, AngleTolerance=radians)  # -> Curve, Simplified
explode = Explode(Curve=simplify_curve.Curve, Recursive=True)  # -> Segments, Vertices
mesh_pipe = MeshPipe(Curve=explode.Segments, Radius=_2_2, Accuracy="3", Rotation=0, Segments="8", Caps=0)
mesh_sphere_ex = MeshSphereEx(Base=explode.Vertices, Radius=_2_2, Count="2")
end_points = EndPoints(Curve=explode.Segments)  # -> Start, End
division_2 = Division(A=_2, B=_2_2)
scale_nu = ScaleNU(Geometry=mesh_sphere_ex, Plane=explode.Vertices, ScaleX=1, ScaleY=division_2, ScaleZ=1)  # -> Geometry, Transform
scale_nu_2 = ScaleNU(Geometry=mesh_pipe, Plane=end_points.Start, ScaleX=1, ScaleY=division_2, ScaleZ=1)  # -> Geometry, Transform
merge_6 = Merge(Data1=scale_nu.Geometry, Data2=scale_nu_2.Geometry)
mesh_3 = Mesh(merge_6)
# Use Render mode, not arctic
rebuild_mesh = RebuildMesh(
    Mesh=mesh_3,
    RebuildNormals=False,
    CullUnused=invert(False),
    UnifyNormals=False,
    FlipNormals=False,
    IdenticalCombine=False,
    WeldVertices=Slider(3, range=0..10))
custom_preview = CustomPreview(Geometry=rebuild_mesh, Material=ColourSwatch(SwatchColor=RGB(217, 214, 193)))

scale = Scale(Geometry=merge, Center=merge_2, Factor=Slider(1000, range=0..1000))  # -> Geometry, Transform
path = FilePath("D:\")

clean = CleanTree(RemoveNulls=True, RemoveInvalid=True, RemoveEmpty=False, Tree=merge_2)
lng = ListLength(List=clean)
concat = Concatenate(FragmentA=lng, FragmentC=" ", FragmentB="Lighthouses connected")
pt_6 = ConstructPoint(XCoordinate=Slider(42, range=0..1000), YCoordinate=Slider(148, range=0..1000), ZCoordinate=0)
texttoscreen = RenderTextToScreen(Text=concat, Location=pt_6, Size=Slider(33, range=0..100), Color=RGB(0, 0, 0), m_scWithvp=False)

entwine = Entwine(Branch00=scale.Geometry, Branch01=merge_2, FlattenInputs=True)
Z_2 = UnitZ(Factor=Slider(1, range=0..100))
brep_5 = Brep(<brep referenced from the Rhino model>)
preview_2 = CustomPreview(Geometry=extr, Material=ColourSwatch(SwatchColor=RGBA(207, 207, 207, 197)))
move = Move(Geometry=extr, Motion=Z_2)  # -> Geometry, Transform
colour_swatch = ColourSwatch(SwatchColor=RGB(255, 255, 255))
pln = Plane(Tree({0;0;0}: [Plane(origin=(978.9841189, -2069.022469, 903.312837), x=(-0.5928168313, 0.689795439, -0.4156325985), y=(-0.8047574615, -0.4878183745, 0.3382287121))], {0;0;1}: [Plane(origin=(976.3482341, -2069.807031, 898.9182876), x=(-0.5872799725, 0.6891087808, -0.4245365969), y=(-0.8087240636, -0.4784275178, 0.3421585877))], {0;0;2}: [Plane(origin=(973.537373, -2072.843563, 885.2642271), x=(-0.6068282315, 0.6642233367, -0.436539639), y=(-0.794553732, -0.4923761296, 0.3553169205))], {0;0;3}: [Plane(origin=(974.2404606, -2074.86465, 881.9334244), x=(-0.6236141294, 0.6477025725, -0.4377062888), y=(-0.7816624477, -0.509161942, 0.3602192869))], {0;0;4}: [Plane(origin=(976.37506, -2075.977755, 877.0837582), x=(-0.6347721682, 0.6334247116, -0.4425352294), y=(-0.7726610486, -0.5146295914, 0.371687083))], {0;0;5}: [Plane(origin=(976.587393, -2073.852837, 876.6545104), x=(-0.6265968966, 0.6377921509, -0.4478811241), y=(-0.7793059914, -0.5071239517, 0.368113392))]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))
pln_2 = Plane([Plane(origin=(837.0803201, -2024.971656, 886.5829899), x=(0.9797521496, 0.187812461, -0.06937005709), y=(-0.1896718743, 0.9816184441, -0.02120872985)), Plane(origin=(836.3490428, -2024.398952, 883.9406903), x=(0.9799346465, 0.1859090289, -0.07187434573), y=(-0.1873253405, 0.9822060489, -0.013434816)), Plane(origin=(835.8468416, -2023.548255, 881.1159946), x=(0.9799745742, 0.1850129214, -0.07362100809), y=(-0.1857739829, 0.9825860256, -0.003567849543)), Plane(origin=(836.933006, -2027.47663, 881.5651553), x=(0.9867487648, 0.1373041564, -0.08645486575), y=(-0.1128965734, 0.9636952965, 0.2419622681)), Plane(origin=(839.5112928, -2034.772207, 881.994666), x=(0.9893262434, 0.1215343038, -0.08039276764), y=(-0.1016234814, 0.9708473303, 0.2170901411)), Plane(origin=(842.087885, -2041.348441, 882.6196715), x=(0.990887856, 0.1165577504, -0.06749479714), y=(-0.1000811094, 0.9725259564, 0.2101833382))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])
smaller = SmallerThan(SecondNumber=0)  # -> SmallerThan, OrEqualTo

number_slider = Slider(153, range=0..200)
explode_2 = Explode(Curve=rec_3pt.Rectangle, Recursive=True)  # -> Segments, Vertices
center = Center(Geometry=explode_2.Segments, forall=True, referenceAll=0)  # -> Center, Dimension
midpt = CurveMiddle(Curve=explode_2.Segments)
Z_3 = UnitZ(Factor=number_slider)
addition = Addition(A=number_slider, B="100")
amp = Amplitude(Vector=Z_3, Amplitude=addition)
move_2 = Move(Geometry=midpt, Motion=Z_3)  # -> Geometry, Transform
move_3 = Move(Geometry=center.Center, Motion=amp)  # -> Geometry, Transform
merge_7 = Merge(Data1=move_2.Geometry, Data2=move_3.Geometry)
vec2pt = Vector2Pt(PointA=merge_7, PointB=center.Center, Unitize=False)  # -> Vector, Length
pt_7 = ConstructPoint(XCoordinate=0, YCoordinate=0, ZCoordinate=0)
pl = PlaneNormal(Origin=merge_7, ZAxis=vec2pt.Vector)

addition_2 = Addition(A=number_slider, B="500")
amp_2 = Amplitude(Vector=Z_3, Amplitude=addition_2)
move_4 = Move(Geometry=center.Center, Motion=amp_2)  # -> Geometry, Transform
flippln = FlipPlane(Plane=move_4.Geometry, FlipX=False, FlipY=False, FlipZ=True)  # -> Flipped, R
ptp = PTPMotion(Plane=flippln.Flipped, Speed=nan, Posture="0")
ptp_path_2 = PTPPath(PTPMotions=ptp, Interpolation="C_PTP")

# ---- group: Tool Center point Offset
vivecalib = ViveCalibrationRecorder(Data=tracker.Plane, Record=Button(), Reset=Button(), Undo=False)  # -> Planes, Points, Tree, Count, Status
tcp = ToolCenterPoint(Poses=vivecalib.Planes)  # -> TCP_Relative, TCP, FixedPoint, Residual, Errors, Status
pt_8 = Point(tcp.TCP)
pdecon = Deconstruct(Point=pt_8)  # -> XComponent, YComponent, ZComponent
neg = Negative(Value=pdecon.XComponent)
neg_2 = Negative(Value=pdecon.YComponent)
neg_3 = Negative(Value=pdecon.ZComponent)
vec = VectorXYZ(XComponent=pdecon.XComponent, YComponent=pdecon.YComponent, ZComponent=pdecon.ZComponent)  # -> Vector, Length
pt_9 = ConstructPoint(XCoordinate=0, YCoordinate=0, ZCoordinate=0)
pt_10 = ConstructPoint(XCoordinate=neg, YCoordinate=neg_2, ZCoordinate=neg_3)
neg_4 = Negative(Value=vec.Vector)
xy_2 = XYPlane(Origin=pt_10)
vdisex = VectorDisplayEx(Point=pt_9, Vector=neg_4, Colour=RGB(0, 0, 0), Width=2)

# ----
xz_2 = XZPlane(Origin=pt_10)
yz_2 = YZPlane(Origin=pt_10)

# ---- group: Tool Center point Offset (continued)
orient_2 = Orient(Geometry=xz_2, Source=xy, Target=tracker.Plane)  # -> Geometry, Transform

# ----
vivecalib_2 = ViveCalibrationRecorder(Data=orient_2.Geometry, Record=Button(), Reset=Button(), Undo=False)  # -> Planes, Points, Tree, Count, Status
item_2 = ListItem(List=vivecalib_2.Points, Index=0, Wrap=True)  # -> Item, Item1, Item2
pl_3pt_2 = Plane3Pt(PointA=item_2.Item, PointB=item_2.Item1, PointC=item_2.Item2)

points_2 = PointList(Points=vivecalib_2.Points, Size=Slider(100, range=0..100))
dam_2 = DataDam(DataA=pl_3pt_2, BufferDelay=10000000, BufferMode=0)

# ---- group: Lighthouses
orient_3 = Orient(Geometry=entwine, Source=dam_2, Target=pl_3pt)  # -> Geometry, Transform

# ---- group: Offset tool Plane
orient_4 = Orient(Geometry=orient_2.Geometry, Source=dam_2, Target=pl_3pt)  # -> Geometry, Transform

# ---- group: Tool mesh
orient_5 = Orient(Geometry=orient.Geometry, Source=dam_2, Target=pl_3pt)  # -> Geometry, Transform

# ---- group: Tracker Plane
orient_6 = Orient(Geometry=tracker.Plane, Source=dam_2, Target=pl_3pt)  # -> Geometry, Transform

# ----
preview_3 = CustomPreview(Geometry=orient_3.Geometry, Material=ColourSwatch(SwatchColor=RGBA(0, 0, 0, 33)))
branch = TreeBranch(Tree=simplify(orient_3.Geometry), Path="1", MaintainPaths=True)
pv_2 = PlaneVisualizer(Plane=orient_4.Geometry)
preview_4 = CustomPreview(Geometry=orient_5.Geometry, Material=ColourSwatch(SwatchColor=RGBA(255, 255, 255, 33)))
circle_fit = CircleFit(Points=branch)  # -> Circle, Radius, Deviation

vivetakes = ViveTakeRecorder(
    Data=orient_4.Geometry,
    Brep=brep_5,
    Record=Toggle(False),
    Delay=0,
    Tolerance=Slider(2, range=0..10),
    Reset=Button(),
    RequireTriggerToRecord=False)  # -> Takes, TakeCount, FrameCount, IsInside, Status
trim = TrimTree(Tree=pln, Depth=1)
pdecon_2 = Deconstruct(Point=trim)  # -> XComponent, YComponent, ZComponent
panel = Panel("1")
intcrv = Interpolate(Vertices=trim, Degree=3, Periodic=False, KnotStyle=1)  # -> Curve, Length, Domain
bnd = Bounds(Numbers=pdecon_2.ZComponent)
panel_2 = Panel(bnd)
previewlw = CustomPreviewLineweights(
    Geometry=intcrv.Curve,
    Shader=ColourSwatch(SwatchColor=RGB(255, 238, 0)),
    Thickness=Slider(21, range=0..100),
    Absolute=False)

pln_3 = Plane(trim)
flippln_2 = FlipPlane(Plane=pln_3, FlipX=False, FlipY=False, FlipZ=True)  # -> Flipped, R
pv_3 = PlaneVisualizer(Plane=flippln_2.Flipped)

orient_7 = OrientPlane(Plane=flippln_2.Flipped, OrientPoint=pt_7)

prot = RotatePlane(Plane=orient_7, Angle=degrees(Slider(-79, range=-180..180)))
ptp_2 = PTPMotion(Plane=prot, Speed=nan, Posture="0")
ptp_path_3 = PTPPath(PTPMotions=ptp_2, Interpolation="C_PTP")
entwine_2 = Entwine(Branch00=ptp_path_2, Branch01=ptp_path_3, Branch02=ptp_path_2, FlattenInputs=True)  # -> flatten(Result)
merge_8 = Merge(Data1=ptp_path_3, Data2=ptp_path_2)
entwine_3 = Entwine(Branch00=ptp_path, Branch01=ptp_path_3, Branch02=ptp_path, FlattenInputs=True)  # -> flatten(Result)
core_abb_rapid = CoreABBRAPID(
    SimulationSlider=Slider(0.191, range=0..1),
    ServerIPPort="https://127.0.0.1:5001",
    PRCCommands=entwine_3,
    Robot=abb_irb6620,
    ToolLibrary=custom_tool,
    massCustomization=False,
    serializedSettings="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",
    settingsOverrideVisible=False)  # -> SimulationValidity, SimulationResult, VisualizationReference
analysis = SimulationAnalysis(SimulationResult=core_abb_rapid.SimulationResult)  # -> AxisValues, CartesianPosition, Time, Colliding, OutOfReach, Singularity, InterpolationFactor, ID, Code, PRCID
visualizer = RobotVisualizer(VisualizationReference=core_abb_rapid.VisualizationReference)  # -> Meshes, Materials, AdditionalData
mesh_4 = Mesh(visualizer.Meshes)
preview_5 = CustomPreview(Geometry=visualizer.Meshes, Material=visualizer.Materials)
mjoin_2 = MeshJoin(Meshes=mesh_4)
py3 = Python3Script(pc_ip="192.168.0.7", code=analysis.Code, folder=path, folder_name="test", write=Button())  # -> out, modified_code
# ---------- py3: Python ----------
import os
import re

# --- Configuration ---
# Takes the pc_ip input directly from the Grasshopper node
my_pc_ip = pc_ip
my_pc_port = 5000
# ---------------------

def transform_rapid_code(input_text, pc_ip, pc_port):
    """Injects TCP socket communication into standard RAPID code with Error Handling."""
    
    variables_to_inject = f"""
    VAR socketdev client_socket;
    VAR string pc_ip := "{pc_ip}"; 
    VAR num pc_port := {pc_port};
    VAR bool socket_connected := FALSE;
"""

    custom_procedure = """
    PROC SendPoseAndCapture(robtarget p, speeddata spd)
        VAR robtarget p_curr;
        VAR string msg;
        VAR string ack;
        
        ! Move to position (always fine for calibration)
        MoveJ p, spd, fine, tool_1\\WObj:=wobjBase;
        
        WaitRob \\InPos;
        WaitTime 0.5;
        
        IF socket_connected THEN
            p_curr := CRobT(\\Tool:=tool_0 \\WObj:=wobjBase);
            
            msg := NumToStr(p_curr.trans.x, 3) + "," +
                   NumToStr(p_curr.trans.y, 3) + "," +
                   NumToStr(p_curr.trans.z, 3) + "," +
                   NumToStr(p_curr.rot.q1, 5) + "," +
                   NumToStr(p_curr.rot.q2, 5) + "," +
                   NumToStr(p_curr.rot.q3, 5) + "," +
                   NumToStr(p_curr.rot.q4, 5);
                   
            SocketSend client_socket \\Str:=msg;
            ! Wait for PC to respond, timeout after 5 seconds
            SocketReceive client_socket \\Str:=ack \\Time:=15; 
        ENDIF
        
    ERROR
        IF ERRNO = ERR_SOCK_TIMEOUT OR ERRNO = ERR_SOCK_CLOSED THEN
            TPWrite "TCP disconnected during capture. Skipping data send.";
            socket_connected := FALSE;
            TRYNEXT;
        ELSE
            TPWrite "Unknown TCP error.";
            socket_connected := FALSE;
            TRYNEXT;
        ENDIF
    ENDPROC
"""

    connection_code = """
        SocketCreate client_socket;
        ! Attempt to connect with a 3-second timeout
        SocketConnect client_socket, pc_ip, pc_port \\Time:=3;
        socket_connected := TRUE;
        TPWrite "Successfully connected to PC.";
"""

    close_code = """
        IF socket_connected THEN
            SocketSend client_socket \\Str:="DONE";
            SocketClose client_socket;
        ENDIF
        
    ERROR
        IF ERRNO = ERR_SOCK_TIMEOUT OR ERRNO = ERR_SOCK_CLOSED THEN
            TPWrite "Could not connect to PC socket. Running offline.";
            socket_connected := FALSE;
            TRYNEXT;
        ELSE
            TPWrite "Unknown error on connection.";
            socket_connected := FALSE;
            TRYNEXT;
        ENDIF
    """

    output_text = input_text

    # 1. Inject Variables before PROC main() - using lambda prevents backslash errors
    output_text = re.sub(r'(\s*PROC main\(\))', lambda m: variables_to_inject + m.group(1), output_text)
    
    # 2. Inject SocketConnect at the start of PROC main()
    output_text = re.sub(r'(PROC main\(\)\s*(?:ConfL \\Off;\s*)?(?:ConfJ \\On;\s*)?)', lambda m: m.group(1) + connection_code, output_text)
    
    # 3. Inject SocketClose and ERROR handling at the end of PROC main()
    output_text = re.sub(r'(\s*ENDPROC\s*ENDMODULE)', lambda m: close_code + m.group(1), output_text)

    # 4. Transform MoveJ to SendPoseAndCapture
    movej_pattern = re.compile(r'MoveJ\s+(\[\[.*?\],\s*\[.*?\],\s*\[.*?\],\s*\[.*?\]\])\s*,\s*([a-zA-Z0-9_]+)\s*,.*?;')
    output_text = movej_pattern.sub(r'SendPoseAndCapture \1, \2;', output_text)
    
    # 5. Append the custom procedure before ENDMODULE
    output_text = re.sub(r'(\s*ENDMODULE)', lambda m: custom_procedure + m.group(1), output_text)
    
    return output_text

# Handle both single string and list
if isinstance(code, list):
    code_text = "\n".join(code)
else:
    code_text = code
        
# Apply our transformation to add TCP functionality
if code_text:
    code_text = transform_rapid_code(code_text, my_pc_ip, my_pc_port)

# --- Execution ---
if write:
    full_path = os.path.join(folder, folder_name)
    
    if not os.path.exists(full_path):
        os.makedirs(full_path)    
    
    mod_path = os.path.join(full_path, "HandtoEye.modx")
    with open(mod_path, "w") as f:
        f.write(code_text)
    
modified_code = code_text
# ---------- end py3 ----------
alignvert = AlignVertices(Mesh=mjoin_2, Tolerance=0.01)  # -> Result, Count
cullvertices = MeshCullUnusedVertices(Mesh=alignvert.Result)
panel_3 = Panel(py3.modified_code)
weldvertices = MeshWeldVertices(Mesh=cullvertices, Tolerance=0.01)  # -> RuntimeMessage, Mesh
wbcatmullclark = WeaverbirdsCatmullClarkSubdivision(MeshCurves=weldvertices.Mesh, Level=1, SmoothNakedEdges=1)
preview_6 = CustomPreview(
    Geometry=wbcatmullclark,
    Material={diffuse=RGB(221, 160, 221), emission=RGB(66, 48, 66), shine=0.5, specular=RGB(255, 255, 255), transparency=0})
sort_along_curve = SortAlongCurve(Points=branch, Curve=circle_fit.Circle)  # -> Points, Indices
intcrv_2 = Interpolate(Vertices=sort_along_curve.Points, Degree="1", Periodic=invert(False), KnotStyle=1)  # -> Curve, Length, Domain
lng_2 = ListLength(List=trim)

# ==== cluster _2
A = ClusterInput()
division = Division(A=A, B=2)
R = ClusterOutput(division)
